# Grasshopper definition sculpt_spectrogram.gh (Grasshopper 1.0.8)
# plug-ins: RhinoCodePluginGH

# Enter frequency cutoffs here:
panel = Panel("C:\\Users\\nwhit\\OneDrive\\Documents\\1 School\\4 - Senior Year\\CSCI 4830 - CAD\\Final Project\\spectrogram data\\Kendrick Lamar - tv off.mp3 Spectrogram Data.csv")
py3 = Python3Script(file_path=panel)  # -> out, time, frequencies, data
# ---------- py3: Python ----------
import csv
from Grasshopper import DataTree
from Grasshopper.Kernel.Data import GH_Path

# Initialize lists and DataTree
time_values = []
frequency_values = []
spectrogram_data = []
tree = DataTree[object]()

# Read the CSV
with open(file_path, 'r') as file:
    reader = csv.reader(file)
    for row_index, row in enumerate(reader):
        if row_index == 0:
            # First row contains time values (skip the first column)
            time_values = [float(value) for value in row]
        else:
            # Remaining rows: first column = frequency, remaining = spectrogram values
            frequency_values.append(float(row[0]))
            spectrogram_data.append([float(value) for value in row[1:]])

# Populate the DataTree
for i, row in enumerate(spectrogram_data):
    path = GH_Path(i)  # Create a branch path for each row
    tree.AddRange(row, path)

# Outputs
time = time_values  # Flat list of time values
frequencies = frequency_values  # Flat list of frequency values
data = tree  # DataTree for spectrogram values
# ---------- end py3 ----------

# ---- group: Bass
smaller = SmallerThan(FirstNumber=py3.frequencies, SecondNumber="250")  # -> SmallerThan, OrEqualTo
cull = CullPattern(List=py3.frequencies, CullPattern=smaller.SmallerThan)
bool = Boolean(True)
mindex = MemberIndex(Set=smaller.SmallerThan, Member=bool)  # -> Index, Count
branch = TreeBranch(Tree=py3.data, Path=mindex.Index, MaintainPaths=True)
flip = FlipMatrix(Data=branch)
avr = Average(Input=flip)  # -> flatten(ArithmeticMean)
number_slider = Slider(10, range=1..10)
avr_2 = Average(Input=avr)
lng = ListLength(List=avr)
subtraction = Subtraction(A=avr, B=avr_2)
range = Range(Domain=lng, Steps=number_slider)
bnd = Bounds(Numbers=subtraction)
amplitude_gain = Slider(4.75, range=0..10)
round = Round(Number=range)  # -> Nearest, Floor, Ceiling
lng_2 = ListLength(List=round.Nearest)
dedomain = DeconstructDomain(Domain=bnd)  # -> Start, End
dom = ConstructDomain(DomainStart=1, DomainEnd=lng_2)
neg = Negative(Value=dedomain.Start)
offset = Slider(3, range=0.1..10)
subset = SubList(List=round.Nearest, Domain=dom, Wrap=False)  # -> List, Index
y_length = Slider(100, range=0..100)
dom_2 = ConstructDomain(DomainStart=round.Nearest, DomainEnd=subset.List)
lng_3 = ListLength(List=dom_2)
addition = Addition(A=neg, B=subtraction)
multiplication = Multiplication(A=addition, B=amplitude_gain)
subtraction_2 = Subtraction(A=lng_3, B=2)
x_length = Slider(100, range=0..100)
addition_2 = Addition(A=multiplication, B=offset)
dom_3 = ConstructDomain(DomainStart=0, DomainEnd=subtraction_2)
subset_2 = SubList(List=dom_2, Domain=dom_3, Wrap=False)  # -> flatten(List), Index
division = Division(A=y_length, B=number_slider)
subset_3 = SubList(List=addition_2, Domain=subset_2.List, Wrap=True)  # -> simplify(List), Index
panel_2 = Panel(subset_2.List)
dom_4 = ConstructDomain(DomainStart=0, DomainEnd=x_length)
lng_4 = ListLength(List=subset_3.List)
range_2 = Range(Domain=dom_4, Steps=lng_4)  # -> simplify(Range)
pt = ConstructPoint(XCoordinate=range_2, YCoordinate=0, ZCoordinate=subset_3.List)
tstat = TreeStatistics(Tree=pt)  # -> Paths, Length, Count
nurbs = NurbsCurve(Vertices=pt, Degree=3, Periodic=False)  # -> Curve, Length, Domain
bass_python_script = Python3Script(amplitude_curves=flatten(nurbs.Curve), y_length=division, x_length=x_length, num_points=tstat.Length)  # -> out, flatten(mesh); inputs amplitude_curves: Curve, y_length: Double, x_length: Double
# ---------- bass_python_script: Python ----------
import numpy as np
import rhinoscriptsyntax as rs
import Rhino.Geometry as rg

# creating X and Y points
x_pts = np.linspace(0, x_length, num_points)
y_pts = [0, y_length]

amplitudes = []
for x in x_pts:
    curve_pt = amplitude_curves.PointAtNormalizedLength(x/x_length)
    amplitudes.append(curve_pt.Z)

# Create points in rows
pts = []
rows = []
for i, amplitude in enumerate(amplitudes):
    row = []
    for y in y_pts:
        row.append(rs.CreatePoint(x_pts[i], y, amplitude))  # create point
    rows.append(row)  # append row to rows
    pts.extend(row)   # flatten all points for mesh vertices

# creating the main mesh (top surface)
mesh = rg.Mesh()
for pt in pts:
    mesh.Vertices.Add(pt.X, pt.Y, pt.Z)

# manually indexing faces because shrinkwraps aren't working
for i in range(len(rows) - 1):
    for j in range(len(rows[i]) - 1):
        p1 = i * len(y_pts) + j
        p2 = p1 + 1
        p3 = p1 + len(y_pts)
        p4 = p3 + 1
        mesh.Faces.AddFace(p1, p2, p4, p3)

# adding walls on each side
# left wall
for i in range(len(rows) - 1):
    base_p1 = rs.CreatePoint(x_pts[i], y_pts[0], 0)
    base_p2 = rs.CreatePoint(x_pts[i + 1], y_pts[0], 0)
    top_p1 = rows[i][0]
    top_p2 = rows[i + 1][0]

    # creating quads for wall
    mesh.Vertices.Add(base_p1.X, base_p1.Y, base_p1.Z)
    mesh.Vertices.Add(base_p2.X, base_p2.Y, base_p2.Z)
    mesh.Vertices.Add(top_p2.X, top_p2.Y, top_p2.Z)
    mesh.Vertices.Add(top_p1.X, top_p1.Y, top_p1.Z)
    mesh.Faces.AddFace(len(mesh.Vertices) - 4, len(mesh.Vertices) - 3, len(mesh.Vertices) - 2, len(mesh.Vertices) - 1)

# right wall
for i in range(len(rows) - 1):
    base_p1 = rs.CreatePoint(x_pts[i], y_pts[1], 0)
    base_p2 = rs.CreatePoint(x_pts[i + 1], y_pts[1], 0)
    top_p1 = rows[i][1]
    top_p2 = rows[i + 1][1]

    # creating quads for wall
    mesh.Vertices.Add(base_p1.X, base_p1.Y, base_p1.Z)
    mesh.Vertices.Add(base_p2.X, base_p2.Y, base_p2.Z)
    mesh.Vertices.Add(top_p2.X, top_p2.Y, top_p2.Z)
    mesh.Vertices.Add(top_p1.X, top_p1.Y, top_p1.Z)
    mesh.Faces.AddFace(len(mesh.Vertices) - 4, len(mesh.Vertices) - 3, len(mesh.Vertices) - 2, len(mesh.Vertices) - 1)

# front and back walls
p1 = rs.CreatePoint(x_pts[0], y_pts[0],0)
p2 = rs.CreatePoint(x_pts[0], y_pts[0],amplitudes[0])
p3 = rs.CreatePoint(x_pts[0], y_pts[1],amplitudes[0])
p4 = rs.CreatePoint(x_pts[0], y_pts[1],0)
mesh.Vertices.Add(p1)
mesh.Vertices.Add(p2)
mesh.Vertices.Add(p3)
mesh.Vertices.Add(p4)
mesh.Faces.AddFace(len(mesh.Vertices) - 4, len(mesh.Vertices) - 3, len(mesh.Vertices) - 2, len(mesh.Vertices) - 1)

p1 = rs.CreatePoint(x_pts[-1], y_pts[-1],0)
p2 = rs.CreatePoint(x_pts[-1], y_pts[-1],amplitudes[-1])
p3 = rs.CreatePoint(x_pts[-1], y_pts[-2],amplitudes[-1])
p4 = rs.CreatePoint(x_pts[-1], y_pts[-2],0)
mesh.Vertices.Add(p1)
mesh.Vertices.Add(p2)
mesh.Vertices.Add(p3)
mesh.Vertices.Add(p4)
mesh.Faces.AddFace(len(mesh.Vertices) - 4, len(mesh.Vertices) - 3, len(mesh.Vertices) - 2, len(mesh.Vertices) - 1)

# base face
p1 = rs.CreatePoint(x_pts[0], y_pts[0],0)
p2 = rs.CreatePoint(x_pts[-1], y_pts[0],0)
p3 = rs.CreatePoint(x_pts[-1], y_pts[-1],0)
p4 = rs.CreatePoint(x_pts[0], y_pts[-1],0)
mesh.Vertices.Add(p1)
mesh.Vertices.Add(p2)
mesh.Vertices.Add(p3)
mesh.Vertices.Add(p4)
mesh.Faces.AddFace(len(mesh.Vertices) - 4, len(mesh.Vertices) - 3, len(mesh.Vertices) - 2, len(mesh.Vertices) - 1)
# ---------- end bass_python_script ----------
series = Series(Start=0, Step=division, Count=number_slider)
Y = UnitY(Factor=series)
move = Move(Geometry=bass_python_script.mesh, Motion=Y)  # -> Geometry, Transform
faceb = FaceBoundaries(Mesh=move.Geometry)
boundary = BoundarySurfaces(Edges=faceb)
join = BrepJoin(Breps=boundary)  # -> Breps, Closed
brep = Brep(simplify(join.Breps))

# ---- group: Treble
larger = LargerThan(FirstNumber=py3.frequencies, SecondNumber="2000")  # -> LargerThan, OrEqualTo
cull_2 = CullPattern(List=py3.frequencies, CullPattern=larger.LargerThan)
bool_2 = Boolean(True)
mindex_2 = MemberIndex(Set=larger.LargerThan, Member=bool_2)  # -> Index, Count
branch_2 = TreeBranch(Tree=py3.data, Path=mindex_2.Index, MaintainPaths=True)
flip_2 = FlipMatrix(Data=branch_2)
avr_3 = Average(Input=flip_2)  # -> flatten(ArithmeticMean)
amplitude_gain_2 = Slider(7.5, range=0..50)
multiplication_2 = Multiplication(A=avr_3, B=amplitude_gain_2)
avr_4 = Average(Input=multiplication_2)
lng_5 = ListLength(List=avr_3)
subtraction_3 = Subtraction(A=multiplication_2, B=avr_4)
range_3 = Range(Domain=lng_5, Steps=number_slider)
bnd_2 = Bounds(Numbers=subtraction_3)
round_2 = Round(Number=range_3)  # -> Nearest, Floor, Ceiling
lng_6 = ListLength(List=round_2.Nearest)
dedomain_2 = DeconstructDomain(Domain=bnd_2)  # -> Start, End
dom_5 = ConstructDomain(DomainStart=1, DomainEnd=lng_6)
neg_2 = Negative(Value=dedomain_2.Start)
subset_4 = SubList(List=round_2.Nearest, Domain=dom_5, Wrap=False)  # -> List, Index
dom_6 = ConstructDomain(DomainStart=round_2.Nearest, DomainEnd=subset_4.List)
lng_7 = ListLength(List=dom_6)
offset_2 = Slider(10, range=0.1..10)
addition_3 = Addition(A=neg_2, B=subtraction_3)
subtraction_4 = Subtraction(A=lng_7, B=2)
dom_7 = ConstructDomain(DomainStart=0, DomainEnd=subtraction_4)
addition_4 = Addition(A=addition_3, B=offset_2)
subset_5 = SubList(List=dom_6, Domain=dom_7, Wrap=False)  # -> flatten(List), Index
division_2 = Division(A=y_length, B=number_slider)
subset_6 = SubList(List=addition_4, Domain=subset_5.List, Wrap=True)  # -> simplify(List), Index
dom_8 = ConstructDomain(DomainStart=0, DomainEnd=x_length)
lng_8 = ListLength(List=subset_6.List)
range_4 = Range(Domain=dom_8, Steps=lng_8)  # -> simplify(Range)
pt_2 = ConstructPoint(XCoordinate=range_4, YCoordinate=0, ZCoordinate=subset_6.List)
tstat_2 = TreeStatistics(Tree=pt_2)  # -> Paths, Length, Count
nurbs_2 = NurbsCurve(Vertices=pt_2, Degree=3, Periodic=False)  # -> Curve, Length, Domain
mid_python_script = Python3Script(
    amplitude_curves=flatten(nurbs_2.Curve),
    y_length=division_2,
    x_length=x_length,
    num_points=tstat_2.Length,
    width_offset=Slider(4.5, range=0..5))  # -> out, flatten(mesh); inputs amplitude_curves: Curve, y_length: Double, x_length: Double
# ---------- mid_python_script: Python ----------
import numpy as np
import rhinoscriptsyntax as rs
import Rhino.Geometry as rg

if 2*width_offset > y_length:
    width_offset = 0

# creating X and Y points
x_pts = np.linspace(0, x_length, num_points)
y_pts = [0 + width_offset, y_length - width_offset]

amplitudes = []
for x in x_pts:
    curve_pt = amplitude_curves.PointAtNormalizedLength(x/x_length)
    amplitudes.append(curve_pt.Z)

# creating points in rows
pts = []
rows = []
for i, amplitude in enumerate(amplitudes):
    row = []
    for y in y_pts:
        row.append(rs.CreatePoint(x_pts[i], y, amplitude))  # create point
    rows.append(row)  # append row to rows
    pts.extend(row)   # flatten all points for mesh vertices

# creating the main mesh
mesh = rg.Mesh()
for pt in pts:
    mesh.Vertices.Add(pt.X, pt.Y, pt.Z)

# manually indexing faces
for i in range(len(rows) - 1):
    for j in range(len(rows[i]) - 1):
        p1 = i * len(y_pts) + j
        p2 = p1 + 1
        p3 = p1 + len(y_pts)
        p4 = p3 + 1
        mesh.Faces.AddFace(p1, p2, p4, p3)

# adding walls on each side
# left wall
for i in range(len(rows) - 1):
    base_p1 = rs.CreatePoint(x_pts[i], y_pts[0], 0)
    base_p2 = rs.CreatePoint(x_pts[i + 1], y_pts[0], 0)
    top_p1 = rows[i][0]
    top_p2 = rows[i + 1][0]

    # creating wall quads
    mesh.Vertices.Add(base_p1.X, base_p1.Y, base_p1.Z)
    mesh.Vertices.Add(base_p2.X, base_p2.Y, base_p2.Z)
    mesh.Vertices.Add(top_p2.X, top_p2.Y, top_p2.Z)
    mesh.Vertices.Add(top_p1.X, top_p1.Y, top_p1.Z)
    mesh.Faces.AddFace(len(mesh.Vertices) - 4, len(mesh.Vertices) - 3, len(mesh.Vertices) - 2, len(mesh.Vertices) - 1)

# right wall
for i in range(len(rows) - 1):
    base_p1 = rs.CreatePoint(x_pts[i], y_pts[1], 0)
    base_p2 = rs.CreatePoint(x_pts[i + 1], y_pts[1], 0)
    top_p1 = rows[i][1]
    top_p2 = rows[i + 1][1]

    # creating wall quads
    mesh.Vertices.Add(base_p1.X, base_p1.Y, base_p1.Z)
    mesh.Vertices.Add(base_p2.X, base_p2.Y, base_p2.Z)
    mesh.Vertices.Add(top_p2.X, top_p2.Y, top_p2.Z)
    mesh.Vertices.Add(top_p1.X, top_p1.Y, top_p1.Z)
    mesh.Faces.AddFace(len(mesh.Vertices) - 4, len(mesh.Vertices) - 3, len(mesh.Vertices) - 2, len(mesh.Vertices) - 1)

# front and back walls
p1 = rs.CreatePoint(x_pts[0], y_pts[0],0)
p2 = rs.CreatePoint(x_pts[0], y_pts[0],amplitudes[0])
p3 = rs.CreatePoint(x_pts[0], y_pts[1],amplitudes[0])
p4 = rs.CreatePoint(x_pts[0], y_pts[1],0)
mesh.Vertices.Add(p1)
mesh.Vertices.Add(p2)
mesh.Vertices.Add(p3)
mesh.Vertices.Add(p4)
mesh.Faces.AddFace(len(mesh.Vertices) - 4, len(mesh.Vertices) - 3, len(mesh.Vertices) - 2, len(mesh.Vertices) - 1)

p1 = rs.CreatePoint(x_pts[-1], y_pts[-1],0)
p2 = rs.CreatePoint(x_pts[-1], y_pts[-1],amplitudes[-1])
p3 = rs.CreatePoint(x_pts[-1], y_pts[-2],amplitudes[-1])
p4 = rs.CreatePoint(x_pts[-1], y_pts[-2],0)
mesh.Vertices.Add(p1)
mesh.Vertices.Add(p2)
mesh.Vertices.Add(p3)
mesh.Vertices.Add(p4)
mesh.Faces.AddFace(len(mesh.Vertices) - 4, len(mesh.Vertices) - 3, len(mesh.Vertices) - 2, len(mesh.Vertices) - 1)

# base face
p1 = rs.CreatePoint(x_pts[0], y_pts[0],0)
p2 = rs.CreatePoint(x_pts[-1], y_pts[0],0)
p3 = rs.CreatePoint(x_pts[-1], y_pts[-1],0)
p4 = rs.CreatePoint(x_pts[0], y_pts[-1],0)
mesh.Vertices.Add(p1)
mesh.Vertices.Add(p2)
mesh.Vertices.Add(p3)
mesh.Vertices.Add(p4)
mesh.Faces.AddFace(len(mesh.Vertices) - 4, len(mesh.Vertices) - 3, len(mesh.Vertices) - 2, len(mesh.Vertices) - 1)
# ---------- end mid_python_script ----------
series_2 = Series(Start=0, Step=division_2, Count=number_slider)
Y_2 = UnitY(Factor=series_2)
move_2 = Move(Geometry=mid_python_script.mesh, Motion=Y_2)  # -> Geometry, Transform
faceb_2 = FaceBoundaries(Mesh=move_2.Geometry)
boundary_2 = BoundarySurfaces(Edges=faceb_2)
join_2 = BrepJoin(Breps=boundary_2)  # -> Breps, Closed
brep_2 = Brep(simplify(join_2.Breps))

# ---- group: Mids
smaller_2 = SmallerThan(FirstNumber=py3.frequencies, SecondNumber="2000")  # -> SmallerThan, OrEqualTo
larger_2 = LargerThan(FirstNumber=py3.frequencies, SecondNumber="250")  # -> LargerThan, OrEqualTo
and = GateAnd(A=smaller_2.SmallerThan, B=larger_2.LargerThan)
cull_3 = CullPattern(List=py3.frequencies, CullPattern=and)
bool_3 = Boolean(True)
mindex_3 = MemberIndex(Set=and, Member=bool_3)  # -> Index, Count
branch_3 = TreeBranch(Tree=py3.data, Path=mindex_3.Index, MaintainPaths=True)
flip_3 = FlipMatrix(Data=branch_3)
avr_5 = Average(Input=flip_3)  # -> flatten(ArithmeticMean)
avr_6 = Average(Input=avr_5)
lng_9 = ListLength(List=avr_5)
subtraction_5 = Subtraction(A=avr_5, B=avr_6)
range_5 = Range(Domain=lng_9, Steps=number_slider)
amplitude_gain_3 = Slider(4.75, range=0..10)
bnd_3 = Bounds(Numbers=subtraction_5)
round_3 = Round(Number=range_5)  # -> Nearest, Floor, Ceiling
lng_10 = ListLength(List=round_3.Nearest)
dedomain_3 = DeconstructDomain(Domain=bnd_3)  # -> Start, End
dom_9 = ConstructDomain(DomainStart=1, DomainEnd=lng_10)
neg_3 = Negative(Value=dedomain_3.Start)
offset_3 = Slider(7.5, range=0.1..10)
subset_7 = SubList(List=round_3.Nearest, Domain=dom_9, Wrap=False)  # -> List, Index
dom_10 = ConstructDomain(DomainStart=round_3.Nearest, DomainEnd=subset_7.List)
lng_11 = ListLength(List=dom_10)
addition_5 = Addition(A=neg_3, B=subtraction_5)
multiplication_3 = Multiplication(A=addition_5, B=amplitude_gain_3)
subtraction_6 = Subtraction(A=lng_11, B=2)
addition_6 = Addition(A=multiplication_3, B=offset_3)
dom_11 = ConstructDomain(DomainStart=0, DomainEnd=subtraction_6)
subset_8 = SubList(List=dom_10, Domain=dom_11, Wrap=False)  # -> flatten(List), Index
division_3 = Division(A=y_length, B=number_slider)
subset_9 = SubList(List=addition_6, Domain=subset_8.List, Wrap=True)  # -> simplify(List), Index
dom_12 = ConstructDomain(DomainStart=0, DomainEnd=x_length)
lng_12 = ListLength(List=subset_9.List)
range_6 = Range(Domain=dom_12, Steps=lng_12)  # -> simplify(Range)
pt_3 = ConstructPoint(XCoordinate=range_6, YCoordinate=0, ZCoordinate=subset_9.List)
tstat_3 = TreeStatistics(Tree=pt_3)  # -> Paths, Length, Count
nurbs_3 = NurbsCurve(Vertices=pt_3, Degree=3, Periodic=False)  # -> Curve, Length, Domain
mid_python_script_2 = Python3Script(
    amplitude_curves=flatten(nurbs_3.Curve),
    y_length=division_3,
    x_length=x_length,
    num_points=tstat_3.Length,
    width_offset=Slider(3, range=0..5))  # -> out, flatten(mesh); inputs amplitude_curves: Curve, y_length: Double, x_length: Double
# ---------- mid_python_script_2: Python ----------
import numpy as np
import rhinoscriptsyntax as rs
import Rhino.Geometry as rg

if 2*width_offset > y_length:
    width_offset = 0

# creating X and Y points
x_pts = np.linspace(0, x_length, num_points)
y_pts = [0 + width_offset, y_length - width_offset]

amplitudes = []
for x in x_pts:
    curve_pt = amplitude_curves.PointAtNormalizedLength(x/x_length)
    amplitudes.append(curve_pt.Z)

# creating points in rows
pts = []
rows = []
for i, amplitude in enumerate(amplitudes):
    row = []
    for y in y_pts:
        row.append(rs.CreatePoint(x_pts[i], y, amplitude))  # create point
    rows.append(row)  # append row to rows
    pts.extend(row)   # flatten all points for mesh vertices

# creating the main mesh (top face)
mesh = rg.Mesh()
for pt in pts:
    mesh.Vertices.Add(pt.X, pt.Y, pt.Z)

# manually indexing faces
for i in range(len(rows) - 1):
    for j in range(len(rows[i]) - 1):
        p1 = i * len(y_pts) + j
        p2 = p1 + 1
        p3 = p1 + len(y_pts)
        p4 = p3 + 1
        mesh.Faces.AddFace(p1, p2, p4, p3)

# adding walls on each side
# left wall
for i in range(len(rows) - 1):
    base_p1 = rs.CreatePoint(x_pts[i], y_pts[0], 0)
    base_p2 = rs.CreatePoint(x_pts[i + 1], y_pts[0], 0)
    top_p1 = rows[i][0]
    top_p2 = rows[i + 1][0]

    # creting wall quads
    mesh.Vertices.Add(base_p1.X, base_p1.Y, base_p1.Z)
    mesh.Vertices.Add(base_p2.X, base_p2.Y, base_p2.Z)
    mesh.Vertices.Add(top_p2.X, top_p2.Y, top_p2.Z)
    mesh.Vertices.Add(top_p1.X, top_p1.Y, top_p1.Z)
    mesh.Faces.AddFace(len(mesh.Vertices) - 4, len(mesh.Vertices) - 3, len(mesh.Vertices) - 2, len(mesh.Vertices) - 1)

# right wall
for i in range(len(rows) - 1):
    base_p1 = rs.CreatePoint(x_pts[i], y_pts[1], 0)
    base_p2 = rs.CreatePoint(x_pts[i + 1], y_pts[1], 0)
    top_p1 = rows[i][1]
    top_p2 = rows[i + 1][1]

    # creating wall quads
    mesh.Vertices.Add(base_p1.X, base_p1.Y, base_p1.Z)
    mesh.Vertices.Add(base_p2.X, base_p2.Y, base_p2.Z)
    mesh.Vertices.Add(top_p2.X, top_p2.Y, top_p2.Z)
    mesh.Vertices.Add(top_p1.X, top_p1.Y, top_p1.Z)
    mesh.Faces.AddFace(len(mesh.Vertices) - 4, len(mesh.Vertices) - 3, len(mesh.Vertices) - 2, len(mesh.Vertices) - 1)

# front and back walls
p1 = rs.CreatePoint(x_pts[0], y_pts[0],0)
p2 = rs.CreatePoint(x_pts[0], y_pts[0],amplitudes[0])
p3 = rs.CreatePoint(x_pts[0], y_pts[1],amplitudes[0])
p4 = rs.CreatePoint(x_pts[0], y_pts[1],0)
mesh.Vertices.Add(p1)
mesh.Vertices.Add(p2)
mesh.Vertices.Add(p3)
mesh.Vertices.Add(p4)
mesh.Faces.AddFace(len(mesh.Vertices) - 4, len(mesh.Vertices) - 3, len(mesh.Vertices) - 2, len(mesh.Vertices) - 1)

p1 = rs.CreatePoint(x_pts[-1], y_pts[-1],0)
p2 = rs.CreatePoint(x_pts[-1], y_pts[-1],amplitudes[-1])
p3 = rs.CreatePoint(x_pts[-1], y_pts[-2],amplitudes[-1])
p4 = rs.CreatePoint(x_pts[-1], y_pts[-2],0)
mesh.Vertices.Add(p1)
mesh.Vertices.Add(p2)
mesh.Vertices.Add(p3)
mesh.Vertices.Add(p4)
mesh.Faces.AddFace(len(mesh.Vertices) - 4, len(mesh.Vertices) - 3, len(mesh.Vertices) - 2, len(mesh.Vertices) - 1)

# base face
p1 = rs.CreatePoint(x_pts[0], y_pts[0],0)
p2 = rs.CreatePoint(x_pts[-1], y_pts[0],0)
p3 = rs.CreatePoint(x_pts[-1], y_pts[-1],0)
p4 = rs.CreatePoint(x_pts[0], y_pts[-1],0)
mesh.Vertices.Add(p1)
mesh.Vertices.Add(p2)
mesh.Vertices.Add(p3)
mesh.Vertices.Add(p4)
mesh.Faces.AddFace(len(mesh.Vertices) - 4, len(mesh.Vertices) - 3, len(mesh.Vertices) - 2, len(mesh.Vertices) - 1)
# ---------- end mid_python_script_2 ----------
series_3 = Series(Start=0, Step=division_3, Count=number_slider)
Y_3 = UnitY(Factor=series_3)
move_3 = Move(Geometry=mid_python_script_2.mesh, Motion=Y_3)  # -> Geometry, Transform
faceb_3 = FaceBoundaries(Mesh=move_3.Geometry)
boundary_3 = BoundarySurfaces(Edges=faceb_3)
join_3 = BrepJoin(Breps=boundary_3)  # -> Breps, Closed
brep_3 = Brep(simplify(join_3.Breps))

# ----
merge = Merge(Data1=brep, Data2=brep_3, Data3=brep_2)  # -> flatten(Result)
